# Grasshopper definition tesselation_v0.1.gh (Grasshopper 1.0.8)

brep = Brep([<brep referenced from the Rhino model> x6])
debrep = DeconstructBrep(Brep=brep)  # -> Faces, Edges, Vertices
item = ListItem(List=debrep.Faces, Index=11, Wrap=True)
debrep_2 = DeconstructBrep(Brep=item)  # -> Faces, Edges, Vertices
item_2 = ListItem(List=debrep_2.Edges, Index=Slider(0, range=0..100), Wrap=True)  # -> flatten(Item)
item_3 = ListItem(List=debrep_2.Edges, Index=1, Wrap=True)  # -> flatten(Item)
panel = Panel(item_3)
flip = FlipCurve(Curve=item_2)  # -> Curve, Flag
shift = ShiftList(List=flip.Curve, Shift=1, Wrap=True)
L = Length(90)
shift_2 = ShiftList(List=item_3, Shift=1, Wrap=False)
lng = ListLength(List=flip.Curve)
divlength = DivideLength(Curve=shift_2, Length=L)  # -> Points, Tangents, Parameters
split = SplitList(List=flip.Curve, Index=expr("x-1", lng))  # -> ListA, ListB
divlength_2 = DivideLength(Curve=split.ListA, Length=90)  # -> Points, Tangents, Parameters
item_4 = ListItem(List=shift_2, Index=0, Wrap=True)
end = EndPoints(Curve=item_4)  # -> Start, End
ln = Line(StartPoint=divlength.Points, EndPoint=divlength_2.Points)
len = Length(Curve=ln)
vec2pt = Vector2Pt(PointA=end.Start, PointB=end.End, Unitize=True)  # -> Vector, Length
panel_2 = Panel("/Users/olgademina/github/Zillwald/bim/group_csv")
py3 = Python3Script(folder=panel_2)  # -> out, a
# ---------- py3: Python ----------
import csv
from pathlib import Path
from collections import Counter

# Folder containing group_*.csv files
folder = Path("/Users/olgademina/github/Zillwald/bim/group_csv")

# Find and sort:
# group_0.csv, group_1.csv, group_2.csv, ...
csv_files = sorted(
    folder.glob("group_*.csv"),
    key=lambda f: int(f.stem.split("_")[1])
)

groups = {}
all_color_counts = Counter()

for csv_file in csv_files:
    group_name = csv_file.stem

    rgb_array = []

    with csv_file.open("r", encoding="utf-8", newline="") as f:
        reader = csv.DictReader(f)

        for row in reader:
            r = int(row["color_r"])
            g = int(row["color_g"])
            b = int(row["color_b"])

            rgb_array.append([r, g, b])

    groups[group_name] = rgb_array

    # Count colors in this group
    color_counts = Counter(tuple(rgb) for rgb in rgb_array)

    print(f"\n{group_name}:")
    for rgb, count in color_counts.items():
        print(f"  RGB {rgb}: {count} elements")

    # Add to total count across all groups
    all_color_counts.update(tuple(rgb) for rgb in rgb_array)


# Individual arrays
a = groups.get("group_0", [])
b = groups.get("group_1", [])
c = groups.get("group_2", [])
d = groups.get("group_3", [])
e = groups.get("group_4", [])


print("\n" + "=" * 40)
print("TOTAL COLORS - ALL GROUPS")
print("=" * 40)

for rgb, count in all_color_counts.items():
    print(f"RGB {rgb}: {count} elements")
# ---------- end py3 ----------
multiplication = Multiplication(A=vec2pt.Vector, B=L)
panel_3 = Panel(len)
panel_4 = Panel(py3.out)
extr = Extrude(Base=ln, Direction=multiplication)
py3_2 = Python3Script(folder=panel_2)  # -> out, a, b, c, d, e
# ---------- py3_2: Python ----------
import csv
from pathlib import Path
import Rhino

# Folder containing group_0.csv, group_1.csv, ...
folder = Path("/Users/olgademina/github/Zillwald/bim/group_csv")

# Find and sort:
# group_0.csv, group_1.csv, group_2.csv, ...
csv_files = sorted(
    folder.glob("group_*.csv"),
    key=lambda f: int(f.stem.split("_")[1])
)

groups = {}

for csv_file in csv_files:
    group_name = csv_file.stem  # e.g. "group_0"

    rgb_array = []

    with csv_file.open("r", encoding="utf-8", newline="") as f:
        reader = csv.DictReader(f)

        for row in reader:
            r = int(row["color_r"])
            g = int(row["color_g"])
            b = int(row["color_b"])
            #
            temp_arr = Rhino.Geometry.Point3d(r, g, b)
            
            rgb_array.append(temp_arr)

    groups[group_name] = rgb_array


# Individual arrays
a = groups.get("group_0", [])
b = groups.get("group_1", [])
c = groups.get("group_2", [])
d = groups.get("group_3", [])
e = groups.get("group_4", [])


print("a =", a)
print("b =", b)
print("c =", c)
print("d =", d)
print("e =", e)
# ---------- end py3_2 ----------
dom = ConstructDomain(DomainStart=Slider(16, range=0..100), DomainEnd=Slider(111, range=0..130))
subset = SubList(List=extr, Domain=dom, Wrap=True)  # -> List, Index
bang = ExplodeTree(Data=subset.List)  # -> _0000, _0010, _0020, _0030, _0040
pdecon = Deconstruct(Point=py3_2.a)  # -> XComponent, YComponent, ZComponent
pdecon_2 = Deconstruct(Point=py3_2.b)  # -> XComponent, YComponent, ZComponent
pdecon_3 = Deconstruct(Point=py3_2.c)  # -> XComponent, YComponent, ZComponent
pdecon_4 = Deconstruct(Point=py3_2.d)  # -> XComponent, YComponent, ZComponent
pdecon_5 = Deconstruct(Point=py3_2.e)  # -> XComponent, YComponent, ZComponent
colour_rgb = ColourRGB(Alpha=255, Red=pdecon.XComponent, Green=pdecon.YComponent, Blue=pdecon.ZComponent)
colour_rgb_2 = ColourRGB(Alpha=255, Red=pdecon_2.XComponent, Green=pdecon_2.YComponent, Blue=pdecon_2.ZComponent)
colour_rgb_3 = ColourRGB(Alpha=255, Red=pdecon_3.XComponent, Green=pdecon_3.YComponent, Blue=pdecon_3.ZComponent)
area = Area(Geometry=bang._0030)  # -> Area, Centroid
colour_rgb_4 = ColourRGB(Alpha=255, Red=pdecon_4.XComponent, Green=pdecon_4.YComponent, Blue=pdecon_4.ZComponent)
colour_rgb_5 = ColourRGB(Alpha=255, Red=pdecon_5.XComponent, Green=pdecon_5.YComponent, Blue=pdecon_5.ZComponent)
brep_2 = Brep(bang._0040)
shift_3 = ShiftList(List=area.Centroid, Shift=2, Wrap=False)
preview = CustomPreview(Geometry=bang._0020, Material=colour_rgb_3)
preview_2 = CustomPreview(Geometry=bang._0030, Material=colour_rgb_4)
preview_3 = CustomPreview(Geometry=bang._0000, Material=colour_rgb)
preview_4 = CustomPreview(Geometry=bang._0010, Material=colour_rgb_2)
preview_5 = CustomPreview(Geometry=bang._0040, Material=colour_rgb_5)
points = PointList(Points=shift_3)
panel_5 = Panel(bang._0000)
item_5 = ListItem(List=area.Area, Index=0, Wrap=True)
