# Grasshopper definition treppe.gh (Grasshopper 1.0.8)

srf = Surface(reparameterize(<surface referenced from the Rhino model>))
number_slider = Slider(6, range=0..10)
sdivide = DivideSurface(Surface=srf, UCount=Slider(61, range=0..100), VCount=Slider(194, range=0..200))  # -> Points, Normals, Parameters
pl = PlaneNormal(Origin=sdivide.Points, ZAxis=sdivide.Normals)
item = ListItem(List=flatten(sdivide.Normals), Index=0, Wrap=True)
multiplication = Multiplication(B=sdivide.Normals)
multiplication_2 = Multiplication(B=item)
cyl = Cylinder(Base=pl, Radius=number_slider, Length=number_slider)
move = Move(Geometry=cyl, Motion=multiplication)  # -> Geometry, Transform
circle = CircleCNR(Center=sdivide.Points, Normal=sdivide.Normals, Radius=number_slider)
edges = BrepEdges(Brep=srf)  # -> Naked, Interior, NonManifold
crv = Curve(srf)
crv_cp = CurveClosestPoint(Point=sdivide.Points, Curve=crv)  # -> Point, Parameter, Distance
item_2 = ListItem(List=flatten(sdivide.Normals), Index=0, Wrap=True)
larger = LargerThan(FirstNumber=crv_cp.Distance, SecondNumber=Slider(10, range=0..10))  # -> LargerThan, OrEqualTo
dispatch = Dispatch(List=move.Geometry, DispatchPattern=larger.LargerThan)  # -> ListA, ListB
dispatch_2 = Dispatch(List=circle, DispatchPattern=larger.LargerThan)  # -> ListA, ListB
pt = Point(dispatch_2.ListA)
crv_2 = Curve(flatten(dispatch_2.ListA))
